# Grasshopper definition offsetCrvs.gh (Grasshopper 1.0.7)

series = Series(Start=0, Step=Slider(2, range=0..2), Count=Slider(21, range=0..100))  # -> expr("-x", Series)
crv = Curve(graft([<curve referenced from the Rhino model> x2]))
bnd = Bounds(Numbers=series)
list = ValueList({"None": 0, "Sharp": 1, "Round": 2, "Smooth": 3, "Chamfer": 4}, selected="Smooth")
remap = RemapNumbers(Value=series, Source=bnd, Target=Domain(0, 1))  # -> Mapped, Clipped
area = Area(Geometry=crv)  # -> Area, Centroid
pt = Point(Point(362.4239031, -63, 0))
graph = GraphMapper(
    remap.Mapped,
    x0=0,
    x1=1,
    y0=0,
    y1=1,
    container_name="Bezier",
    cpx=[0, 0.4309236705, 0.2476811111, 1],
    cpy=[0, 0.375344336, 1, 1])
remap_2 = RemapNumbers(Value=graph, Source=Domain(0, 1), Target=bnd)  # -> Mapped, Clipped
python = GhPythonScript(crv=crv, dir=area.Centroid, dist=remap_2.Mapped, style=list)  # -> out, a; inputs crv: Curve, dir: Vector3d, style: Int32
# ---------- python: Python ----------
__author__ = "ching"
__version__ = "2021.11.26"

import rhinoscriptsyntax as rs

a=rs.OffsetCurve(crv, dir, dist, None, style)
# ---------- end python ----------
crv_2 = Curve(python.a)
